# Grasshopper definition UDP _Receiver_data_for_assembly.gh (Grasshopper 1.0.7)
# plug-ins: treesloth01, Robots, Sasquatch, gHowl

# ---- group: UDP import objects
panel = Panel("8051")
# UDP_receiver from Unity
panel_2 = Panel("127.0.0.1")
udp = UDPReceiver(Address=panel_2, Port=6002, Pattern=0)  # -> Info, Data
panel_3 = Panel(udp.Info)
rec = DataRecorder(udp.Data, DataLimit=-10, RecordData=True)
panel_4 = Panel(udp.Data)
split = TextSplit(Text=rec, Separators="(")
join = TextJoin(Text=split, Join="{")
split_2 = TextSplit(Text=join, Separators=")")
join_2 = TextJoin(Text=split_2, Join="}")  # -> flatten(Result)
X = UnitX(Factor=1)
pt = Point(join_2)
rot3d = Rotate3D(Geometry=pt, Angle=1.570796327, Center=Point(0, 0, 0), Axis=X)  # -> Geometry, Transform
scale = Scale(Geometry=rot3d.Geometry, Center=Point(0, 0, 0), Factor=Slider(100, range=0..100))  # -> Geometry, Transform
cullpt = CullDuplicates(Points=scale.Geometry, Tolerance=0.1, CullMode=3)  # -> Points, Indices, Valence
panel_5 = Panel(cullpt.Points)

# ---- group: UDP import objects / Distribution of objects
geo = Geometry(<mesh referenced from the Rhino model>)
volume = Volume(Geometry=geo)  # -> Volume, Centroid
orient = Orient(Geometry=geo, Source=volume.Centroid, Target=cullpt.Points)  # -> Geometry, Transform

# ----
number_slider = Slider(2, range=0..10)
brep = Brep([<brep referenced from the Rhino model> x4])
scale_2 = Scale(Geometry=brep, Center=Point(0, 0, 0), Factor=Slider(0.5, range=0..1))  # -> Geometry, Transform
panel_6 = Panel("0,pi/2,0,0,0,0")
list = FlagFields({"Shoulder": 1, "Elbow": 2, "Wrist": 4}, selected=[])
list_2 = RobotsLibrary(
    {"AA-KR60", "AA-KR30", "AA-KR60_KR30", "AARCH IRB120", "AARCH IRB6620", "AAU-Utzon-UR10", "Automata", "Franka Emika Panda", "Bartlett-IRB120", "Bartlett-IRB1600"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}, selected="Bartlett-KR6",
    Type=0)
pt_2 = Point(<point referenced from the Rhino model>)
load_robot = LoadRobotSystem(Name=list_2, Base=pt_2)

# ---- group: PICK POSITION
geo_2 = Geometry(<mesh referenced from the Rhino model>)
bbox = BoundingBox(Content=geo_2, Plane=PlaneXY(0, 0, 0))  # -> Box, Box_2
volume_2 = Volume(Geometry=bbox.Box_2)  # -> Volume, Centroid
Z = UnitZ(Factor=Slider(60, range=0..1000))
X_2 = UnitX(Factor=Slider(-1, range=-150..1000))
Y = UnitY(Factor=Slider(50, range=0..1000))
move = Move(Geometry=volume_2.Centroid, Motion=Z)  # -> Geometry, Transform
addition = Addition(A=X_2, B=Y)
move_2 = Move(Geometry=move.Geometry, Motion=addition)  # -> Geometry, Transform
pt_3 = Point(move_2.Geometry)
pl = ConstructPlane(Origin=pt_3, XAxis=expr("-X", Vector(1, 0, 0)), YAxis=Vector(0, 1, 0))

# ---- group: PICK POSITION / Pick Retract distance (hover) to avoid collisions
Z_2 = UnitZ(Factor=Slider(350, range=0..1000))
move_3 = Move(Geometry=pl, Motion=Z_2)  # -> Geometry, Transform
ins = InsertItems(List=pl, Item=move_3.Geometry, Indices=[0, -1], Wrap=True)

# ---- group: PICK POSITION (continued)
prot = RotatePlane(Plane=ins, Angle=degrees(Slider(90, range=0..1000)))

# ---- group: PLACE POSITION
# Pick and Place scenario - standard
geo_3 = Geometry(reverse([<mesh referenced from the Rhino model> x14]))
bbox_2 = BoundingBox(Content=geo_3, Plane=PlaneXY(0, 0, 0))  # -> Box, Box_2
Z_3 = UnitZ(Factor=Slider(60, range=0..1000))
X_3 = UnitX(Factor=Slider(68, range=0..1000))
Y_2 = UnitY(Factor=Slider(-20, range=-50..100))
volume_3 = Volume(Geometry=bbox_2.Box)  # -> Volume, reverse(graft(Centroid))
addition_2 = Addition(A=X_3, B=Z_3, C=Y_2)
move_4 = Move(Geometry=volume_3.Centroid, Motion=addition_2)  # -> Geometry, Transform
pln = Plane(graft(move_4.Geometry))

# ---- group: PLACE POSITION / Place retrack distance to avoid collisions
Z_4 = UnitZ(Factor=Slider(240, range=0..1000))
move_5 = Move(Geometry=pln, Motion=Z_4)  # -> Geometry, Transform

# ---- group: PLACE POSITION (continued)
ins_2 = InsertItems(List=pln, Item=move_5.Geometry, Indices=[0, -1], Wrap=True)

# ---- group: PLACE POSITION / This is significant how to position and rotate the end effector properly
pflip = FlipPlane(Plane=ins_2, ReverseX=False, ReverseY=True, SwapAxes=False)

# ---- group: PLACE POSITION (continued)
renumber = RenumberPaths(Data=pflip)  # -> reverse(RenumberedData)

# ----
ins_3 = InsertItems(List=renumber, Item=prot, Indices=0, Wrap=True)  # -> simplify(graft(List))
trim = TrimTree(Tree=ins_3, Depth=1)

panel_7 = Panel("""0
0
0
1
1
1""")
pt_4 = Point(Point(117.2692901, -26.54362745, 14.21676473))
xy = XYPlane(Origin=pt_4)
null = Null(Count=1)
frame = CreateFrame(Plane=xy, CoupledMechanicalGroup=-1, CoupledMechanism=-1)
frame_2 = FrameParameter(frame)
p_n_c = PickNChoose(Pattern=graft(panel_7), Stream0=null, Stream1=frame_2)  # -> flatten(Result)
long = LongestList(ListA=trim, ListB=p_n_c, PaddingMode=2)  # -> ListA, graft(ListB)
clean = CleanTree(RemoveNulls=True, RemoveInvalid=True, RemoveEmpty=False, Tree=long.ListB)

panel_8 = Panel("""0
1
1
0
1
1""")
list_3 = ValueList({"Joint", "Linear"}, selected="Joint")
list_4 = ValueList({"Joint", "Linear"}, selected="Linear")
tspeed = SpeedParameter(Slider(200, range=0..1000))
tpspeed = SpeedParameter(Slider(50, range=0..100))
p_n_c_2 = PickNChoose(Pattern=graft(panel_8), Stream0=list_3, Stream1=list_4)  # -> flatten(Result)
p_n_c_3 = PickNChoose(Pattern=graft(panel_8), Stream0=tspeed, Stream1=tpspeed)  # -> flatten(Result)
long_2 = LongestList(ListA=trim, ListB=p_n_c_2, PaddingMode=2)  # -> ListA, graft(ListB)
long_3 = LongestList(ListA=trim, ListB=p_n_c_3, PaddingMode=2)  # -> ListA, graft(ListB)

panel_9 = Panel("""0
1
0
0
1
0""")
zone = ZoneParameter(Slider(3, range=0..10))
zone_2 = ZoneParameter(Slider(0, range=0..10))
p_n_c_4 = PickNChoose(Pattern=graft(panel_9), Stream0=zone, Stream1=zone_2)  # -> flatten(Result)
long_4 = LongestList(ListA=trim, ListB=p_n_c_4, PaddingMode=2)  # -> ListA, graft(ListB)

# ----
# Frame is basically a certain definition of a vector according to with the defined position of the targets are shifted. Some sort of a working plane. This is also useful for the multi-robotic setup.
frame_3 = CreateFrame(Plane=xy, CoupledMechanicalGroup=-1, CoupledMechanism=-1)
panel_10 = Panel(frame_3)
panel_11 = Panel(clean)

number_slider_2 = Slider(1, range=0..1)
number_slider_3 = Slider(1, range=0..1)
panel_12 = Panel("""0
1
0
0
2
0""")
wait = Wait(Time=number_slider)
wait_2 = Wait(Time=number_slider)
setdo = SetDO(DO=Slider(0, range=0..100), Value=Slider(0, range=0..1))
setdo_2 = SetDO(DO=Slider(0, range=0..100), Value=Slider(1, range=0..1))
groupcmd = GroupCommand(Commands=[wait_2, setdo])
groupcmd_2 = GroupCommand(Commands=[wait, setdo_2])
null_2 = Null(Count=1)

# ---- group: Gripper Close
gripperclose = CommandParameter(groupcmd_2)

# ---- group: Gripper open
gripperopen = CommandParameter(groupcmd)

# ----
p_n_c_5 = PickNChoose(Pattern=graft(panel_12), Stream0=null_2, Stream1=gripperclose, Stream2=gripperopen)  # -> flatten(Result)
long_5 = LongestList(ListA=trim, ListB=p_n_c_5, PaddingMode=2)  # -> ListA, graft(ListB)
clean_2 = CleanTree(RemoveNulls=True, RemoveInvalid=True, RemoveEmpty=False, Tree=long_5.ListB)

pt_5 = Point(Point(140.7415322, 0, 69.76912116))
mesh = MeshBrep(
    Brep=scale_2.Geometry,
    Settings={GridMaxCount=0, GridMinCount=16, JaggedSeams=False, MaxEdgeLength=0, MinEdgeLength=0.0001, MinTolerance=0, Refine=True, RefineAngle=0, RelativeTolerance=0.65, SimplePlanes=True, Tolerance=0})
mjoin = MeshJoin(Meshes=mesh)

xy_2 = XYPlane(Origin=pt_5)

tool = CreateTool(Name="DefaultGHTool", TCP=xy_2, Weight=0, Mesh=mjoin)  # -> Tool, TCP

# ---- group: Home position
target = CreateTarget(Joints="pi/2,pi/2,0,0,0,0", Tool=tool.Tool, IsCartesian=False)

# ----
target_2 = CreateTarget(
    Plane=ins_3,
    RobConf=list,
    Motion=long_2.ListB,
    Tool=tool.Tool,
    Speed=long_3.ListB,
    Zone=long_4.ListB,
    Command=clean_2,
    IsCartesian=True)  # -> flatten(Target)
ins_4 = InsertItems(List=target_2, Item=target, Indices=[0, -1], Wrap=True)
program = CreateProgram(Name="Assembly", RobotSystem=load_robot, Targets=flatten(ins_4), StepSize=1)  # -> Program, Code, Duration, Warnings, Errors
panel_13 = Panel(program.Warnings)
sim = ProgramSimulation(Program=program.Program, Time=Slider(0, range=0..1), Normalized=True)  # -> SystemMeshes, JointRotations, Plane, Index, Time, Program, Errors
split_3 = SplitList(List=sim.SystemMeshes, Index=7)  # -> ListA, ListB
panel_14 = Panel(sim.Program)
preview = CustomPreview(Geometry=split_3.ListA, Material=ColourSwatch(SwatchColor=RGBA(255, 101, 0, 166)))
preview_2 = CustomPreview(Geometry=split_3.ListB, Material=ColourSwatch(SwatchColor=RGBA(0, 0, 0, 88)))
panel_15 = Panel(program.Code)
saveprog = SaveProgram(Program=sim.Program, Folder="D:\DF_workshop_setup\pick_place")
