# Grasshopper definition components_production_complete.gh (Grasshopper 1.0.7)
# plug-ins: treesloth01, Robots, Sasquatch, gHowl, OpenNest, Bifocals, Pufferfish

# ---- group: Rectangular component
rectangle = Rectangle(Plane=PlaneXY(0, 0, 0), XSize=Slider(79, range=0..1000), YSize=Slider(250, range=0..1000), Radius=0)  # -> Rectangle, Length
fillet = Fillet(Curve=rectangle.Rectangle, Radius=Slider(10, range=0..100))
debrep = DeconstructBrep(Brep=fillet)  # -> Faces, Edges, Vertices
item = ListItem(List=debrep.Edges, Index=0, Wrap=True)  # -> Item, Item1, Item2, Item3, Item4, Item5, Item6, Item7
crv = Curve(item.Item2)
crv_2 = Curve(item.Item4)
crv_3 = Curve(item.Item)
crv_4 = Curve(item.Item6)
kinkcrv = KinkyCurve(Vertices=debrep.Vertices, Degree=Slider(3, range=0..10), Angle=Slider(0, range=0..1))  # -> Curve, Length, Domain
end = EndPoints(Curve=crv)  # -> Start, End
end_2 = EndPoints(Curve=crv_3)  # -> Start, End
end_3 = EndPoints(Curve=crv_2)  # -> Start, End
end_4 = EndPoints(Curve=crv_4)  # -> Start, End
debrep_2 = DeconstructBrep(Brep=rectangle.Rectangle)  # -> Faces, Edges, Vertices
area = Area(Geometry=rectangle.Rectangle)  # -> Area, Centroid
ln = Line(StartPoint=end_2.Start, EndPoint=end_2.End)
ln_2 = Line(StartPoint=end_3.Start, EndPoint=end_3.End)
ln_3 = Line(StartPoint=end.Start, EndPoint=end.End)
ln_4 = Line(StartPoint=end_4.Start, EndPoint=end_4.End)
pull = PullPoint(Point=graft(area.Centroid), Geometry=graft(debrep_2.Edges), ClosestOnly=True)  # -> flatten(ClosestPoint), Distance
neg = Negative(Value=Slider(10, range=0..100))
merge = Merge(Data1=ln, Data2=item.Item1, Data3=ln_3, Data4=item.Item3, Data5=ln_2, Data6=item.Item5, Data7=ln_4, Data8=item.Item7)
offset = OffsetCurve(Curve=[ln, ln_3, ln_2, ln_4], Distance=neg, Corners=1)  # -> flatten(Curve)
join = JoinCurves(Curves=merge, Preserve=False)
ln_5 = Line(StartPoint=area.Centroid, EndPoint=pull.ClosestPoint)
midpt = CurveMiddle(Curve=[ln, ln_3, ln_2, ln_4])
item_2 = ListItem(List=ln_5, Index=0, Wrap=True)  # -> Item, Item1, Item2, Item3
thisckness_of_the_material = Slider(9, range=0..100)
tolerance = Slider(1, range=0..5)
number_slider = Slider(50, range=0..100)
crv_5 = Curve(item_2.Item1)
crv_6 = Curve(item_2.Item3)
pull_2 = PullPoint(Point=midpt, Geometry=offset, ClosestOnly=True)  # -> ClosestPoint, Distance
pt = Point(midpt)
merge_2 = Merge(Data1=crv_5, Data2=crv_6)
pt_2 = Point(area.Centroid)
division = Division(A=tolerance, B="2")
division_2 = Division(A=thisckness_of_the_material, B="2")
crv_7 = Curve(debrep_2.Edges)
neg_2 = Negative(Value=number_slider)
vec2pt = Vector2Pt(PointA=pt, PointB=pull_2.ClosestPoint, Unitize=Toggle(True))  # -> Vector, Length
ln_6 = Line(StartPoint=pt_2, EndPoint=pt)
addition = Addition(A=division_2, B=division)
multiplication = Multiplication(A=vec2pt.Vector, B=Slider(30, range=0..100))
offset_2 = OffsetCurve(Curve=merge_2, Distance=neg_2, Corners=1)
offset_3 = OffsetCurve(Curve=merge_2, Distance=number_slider, Corners=1)
move = Move(Geometry=pt, Motion=multiplication)  # -> Geometry, Transform
merge_3 = Merge(Data1=offset_3, Data2=offset_2)
neg_3 = Negative(Value=addition)
join_2 = JoinCurves(Curves=merge_3, Preserve=False)
neg_4 = Negative(Value=Slider(30, range=0..100))
ln_7 = Line(StartPoint=pt, EndPoint=move.Geometry)
merge_4 = Merge(Data1=item_2.Item, Data2=item_2.Item2, Data3=join_2)  # -> flatten(Result)
offset_4 = OffsetCurve(Curve=merge_4, Distance=neg_3, Corners=1)
offset_5 = OffsetCurve(Curve=merge_4, Distance=addition, Corners=1)
offset_6 = OffsetCurve(Curve=crv_7, Distance=neg_4, Corners=1)
merge_5 = Merge(Data1=offset_5, Data2=offset_4)
ccx = CurveCurve(CurveA=offset_6, CurveB=flatten(merge_5))  # -> Points, ParamsA, ParamsB
offset_7 = OffsetCurve(Curve=ln_7, Distance=addition, Corners=1)
offset_8 = OffsetCurve(Curve=ln_7, Distance=neg_3, Corners=1)
panel = Panel(merge_5)
trim = TrimTree(Tree=ccx.Points, Depth=1)
end_5 = EndPoints(Curve=offset_8)  # -> Start, End
end_6 = EndPoints(Curve=offset_7)  # -> Start, End
item_3 = ListItem(List=trim, Index=0, Wrap=True)  # -> Item, Item1, Item2, Item3
number_slider_2 = Slider(9, range=0..10)
bang = ExplodeTree(Data=trim)  # -> Branch0, Branch1, Branch2, Branch3, Branch4, Branch5
geo = Geometry(flatten(item_3.Item2))
geo_2 = Geometry(flatten(item_3.Item3))
ln_8 = Line(StartPoint=end_6.Start, EndPoint=end_5.Start)
number_slider_3 = Slider(4, range=0..10)
ln_9 = Line(StartPoint=end_6.End, EndPoint=end_5.End)
number_slider_4 = Slider(2, range=0..10)
number_slider_5 = Slider(0, range=0..1)
flatten = FlattenTree(Tree=bang.Branch0, Path="{0}")
flatten_2 = FlattenTree(Tree=bang.Branch2, Path="{0}")
flatten_3 = FlattenTree(Tree=bang.Branch3, Path="{0}")
flatten_4 = FlattenTree(Tree=bang.Branch1, Path="{0}")
cull_i = CullIndex(List=geo_2, Indices=[number_slider_4, number_slider_5], Wrap=True)
cull_i_2 = CullIndex(List=geo, Indices=[number_slider_4, number_slider_5], Wrap=True)
item_4 = ListItem(List=flatten, Index=0, Wrap=True)  # -> Item, Item1
item_5 = ListItem(List=flatten_2, Index=0, Wrap=True)  # -> Item, Item1
ext = ExtendCurve(Curve=ln_9, Type=0, Start=number_slider_3, End=number_slider_3)
item_6 = ListItem(List=flatten_4, Index=0, Wrap=True)  # -> Item, Item1
item_7 = ListItem(List=flatten_3, Index=0, Wrap=True)  # -> Item, Item1
ln_10 = Line(StartPoint=cull_i_2, EndPoint=cull_i)
ln_11 = Line(StartPoint=item_7.Item, EndPoint=item_7.Item1)
ln_12 = Line(StartPoint=item_5.Item, EndPoint=item_5.Item1)
ln_13 = Line(StartPoint=item_6.Item, EndPoint=item_6.Item1)
ln_14 = Line(StartPoint=item_4.Item, EndPoint=item_4.Item1)
neg_5 = Negative(Value=number_slider_2)
item_8 = ListItem(List=ln_10, Index=0, Wrap=True)  # -> Item, Item1
offset_9 = OffsetCurve(Curve=ext, Distance=neg_5, Corners=1)
end_7 = EndPoints(Curve=ext)  # -> Start, End
end_8 = EndPoints(Curve=offset_9)  # -> Start, End
ln_15 = Line(StartPoint=end_7.Start, EndPoint=end_8.Start)
ln_16 = Line(StartPoint=end_7.End, EndPoint=end_8.End)
merge_6 = Merge(Data1=ln_8, Data2=ln_9, Data3=offset_7, Data4=offset_8)  # -> flatten(Result)
merge_7 = Merge(Data1=ln_15, Data2=ln_16, Data3=offset_9, Data4=ext)  # -> flatten(Result)
merge_8 = Merge(Data1=ln_14, Data2=ln_13, Data3=ln_12, Data4=ln_11, Data5=item_8.Item, Data6=item_8.Item1)  # -> flatten(Result)
number_slider_6 = Slider(4, range=0..10)
merge_9 = Merge(Data1=ln_14, Data2=ln_13, Data3=ln_12, Data4=ln_11, Data5=item_8.Item, Data6=item_8.Item1)  # -> flatten(Result)
join_3 = JoinCurves(Curves=merge_6, Preserve=False)
join_4 = JoinCurves(Curves=merge_7, Preserve=False)
ext_2 = ExtendCurve(Curve=merge_8, Type=0, Start=number_slider_6, End=number_slider_6)
offset_10 = OffsetCurve(Curve=merge_9, Distance=Slider(50, range=0..100), Corners=1)  # -> flatten(Curve)
Z = UnitZ(Factor=thisckness_of_the_material)
merge_10 = Merge(Data1=join_3, Data2=join_4)
end_9 = EndPoints(Curve=offset_10)  # -> Start, End
end_10 = EndPoints(Curve=merge_9)  # -> Start, End
offset_11 = OffsetCurve(Curve=ext_2, Distance=number_slider_2, Corners=1)
ln_17 = Line(StartPoint=end_9.Start, EndPoint=end_10.Start)
ln_18 = Line(StartPoint=end_9.End, EndPoint=end_10.End)
merge_11 = Merge(Data1=ln_17, Data2=ln_18)
end_11 = EndPoints(Curve=offset_11)  # -> Start, End
end_12 = EndPoints(Curve=ext_2)  # -> graft(Start), graft(End)
merge_12 = Merge(Data1=merge_9, Data2=merge_11, Data3=offset_10)
ln_19 = Line(StartPoint=end_11.End, EndPoint=end_12.End)
ln_20 = Line(StartPoint=end_11.Start, EndPoint=end_12.Start)
join_5 = JoinCurves(Curves=merge_12, Preserve=False)
merge_13 = Merge(Data1=ext_2, Data2=offset_11, Data3=ln_20, Data4=ln_19)  # -> flatten(Result)
rdiff = RegionDifference(CurvesA=join, CurvesB=join_5)
join_6 = JoinCurves(Curves=merge_13, Preserve=False)
rdiff_2 = RegionDifference(CurvesA=rdiff, CurvesB=join_6)
runion = RegionUnion(Curves=merge_10)
rdiff_3 = RegionDifference(CurvesA=rdiff_2, CurvesB=runion)
extr = Extrude(Base=rdiff_2, Direction=Z)
extr_2 = Extrude(Base=rdiff_3, Direction=Z)
cap = CapHoles(Brep=extr)
cap_2 = CapHoles(Brep=extr_2)

# ---- group: Square Connector component
rectangle_2 = Rectangle(Plane=PlaneXY(0, 0, 0), XSize=Slider(100, range=0..1000), YSize=Slider(100, range=0..1000), Radius=0)  # -> Rectangle, Length
debrep_3 = DeconstructBrep(Brep=rectangle_2.Rectangle)  # -> Faces, Edges, Vertices
area_2 = Area(Geometry=rectangle_2.Rectangle)  # -> Area, Centroid
thisckness_of_the_material_2 = Slider(9, range=0..100)
tolerance_2 = Slider(1, range=0..5)
pull_3 = PullPoint(Point=graft(area_2.Centroid), Geometry=graft(debrep_3.Edges), ClosestOnly=True)  # -> flatten(ClosestPoint), Distance
pt_3 = Point(debrep_3.Vertices)
pt_4 = Point(area_2.Centroid)
division_3 = Division(A=tolerance_2, B="2")
division_4 = Division(A=thisckness_of_the_material_2, B="2")
vec2pt_2 = Vector2Pt(PointA=pt_3, PointB=pt_4, Unitize=Toggle(True))  # -> Vector, Length
crv_8 = Curve(debrep_3.Edges)
ln_21 = Line(StartPoint=area_2.Centroid, EndPoint=pull_3.ClosestPoint)
addition_2 = Addition(A=division_4, B=division_3)
ln_22 = Line(StartPoint=pt_4, EndPoint=pt_3)
multiplication_2 = Multiplication(A=vec2pt_2.Vector, B=Slider(30, range=0..100))
move_2 = Move(Geometry=pt_3, Motion=multiplication_2)  # -> Geometry, Transform
neg_6 = Negative(Value=addition_2)
neg_7 = Negative(Value=Slider(30, range=0..100))
ln_23 = Line(StartPoint=pt_3, EndPoint=move_2.Geometry)
offset_12 = OffsetCurve(Curve=ln_21, Distance=addition_2, Corners=1)
offset_13 = OffsetCurve(Curve=ln_21, Distance=neg_6, Corners=1)
offset_14 = OffsetCurve(Curve=crv_8, Distance=neg_7, Corners=1)
merge_14 = Merge(Data1=offset_12, Data2=offset_13)
ccx_2 = CurveCurve(CurveA=offset_14, CurveB=merge_14)  # -> Points, ParamsA, ParamsB
offset_15 = OffsetCurve(Curve=ln_23, Distance=addition_2, Corners=1)
offset_16 = OffsetCurve(Curve=ln_23, Distance=neg_6, Corners=1)
panel_2 = Panel(merge_14)
viewer = ParamViewer(ccx_2.Points)
end_13 = EndPoints(Curve=offset_16)  # -> Start, End
end_14 = EndPoints(Curve=offset_15)  # -> Start, End
trim_2 = TrimTree(Tree=ccx_2.Points, Depth=1)
number_slider_7 = Slider(9, range=0..10)
bang_2 = ExplodeTree(Data=trim_2)  # -> Branch0, Branch1, Branch2, Branch3
item_9 = ListItem(List=trim_2, Index=0, Wrap=True)  # -> Item, Item1, Item2, Item3
number_slider_8 = Slider(4, range=0..10)
ln_24 = Line(StartPoint=end_14.Start, EndPoint=end_13.Start)
ln_25 = Line(StartPoint=end_14.End, EndPoint=end_13.End)
flatten_5 = FlattenTree(Tree=bang_2.Branch0, Path="{0}")
flatten_6 = FlattenTree(Tree=bang_2.Branch2, Path="{0}")
flatten_7 = FlattenTree(Tree=bang_2.Branch3, Path="{0}")
flatten_8 = FlattenTree(Tree=bang_2.Branch1, Path="{0}")
item_10 = ListItem(List=flatten_5, Index=0, Wrap=True)  # -> Item, Item1
item_11 = ListItem(List=flatten_6, Index=0, Wrap=True)  # -> Item, Item1
ext_3 = ExtendCurve(Curve=ln_25, Type=0, Start=number_slider_8, End=number_slider_8)
item_12 = ListItem(List=flatten_8, Index=0, Wrap=True)  # -> Item, Item1
item_13 = ListItem(List=flatten_7, Index=0, Wrap=True)  # -> Item, Item1
ln_26 = Line(StartPoint=item_11.Item, EndPoint=item_11.Item1)
ln_27 = Line(StartPoint=item_13.Item, EndPoint=item_13.Item1)
ln_28 = Line(StartPoint=item_12.Item, EndPoint=item_12.Item1)
ln_29 = Line(StartPoint=item_10.Item, EndPoint=item_10.Item1)
neg_8 = Negative(Value=number_slider_7)
number_slider_9 = Slider(4, range=0..10)
offset_17 = OffsetCurve(Curve=ext_3, Distance=neg_8, Corners=1)
merge_15 = Merge(Data1=ln_29, Data2=ln_28, Data3=ln_26, Data4=ln_27)
merge_16 = Merge(Data1=ln_29, Data2=ln_28, Data3=ln_26, Data4=ln_27)
end_15 = EndPoints(Curve=ext_3)  # -> Start, End
end_16 = EndPoints(Curve=offset_17)  # -> Start, End
ext_4 = ExtendCurve(Curve=merge_15, Type=0, Start=number_slider_9, End=number_slider_9)
offset_18 = OffsetCurve(Curve=merge_16, Distance=Slider(60, range=0..100), Corners=1)  # -> flatten(Curve)
end_17 = EndPoints(Curve=merge_15)  # -> Start, End
end_18 = EndPoints(Curve=offset_18)  # -> Start, End
ln_30 = Line(StartPoint=end_15.Start, EndPoint=end_16.Start)
ln_31 = Line(StartPoint=end_15.End, EndPoint=end_16.End)
merge_17 = Merge(Data1=ln_24, Data2=ln_25, Data3=offset_15, Data4=offset_16)  # -> flatten(Result)
merge_18 = Merge(Data1=ln_30, Data2=ln_31, Data3=offset_17, Data4=ext_3)  # -> flatten(Result)
ln_32 = Line(StartPoint=end_17.Start, EndPoint=end_18.Start)
ln_33 = Line(StartPoint=end_17.End, EndPoint=end_18.End)
offset_19 = OffsetCurve(Curve=ext_4, Distance=number_slider_7, Corners=1)
merge_19 = Merge(Data1=ln_32, Data2=ln_33)
join_7 = JoinCurves(Curves=merge_17, Preserve=False)
join_8 = JoinCurves(Curves=merge_18, Preserve=False)
end_19 = EndPoints(Curve=offset_19)  # -> Start, End
end_20 = EndPoints(Curve=ext_4)  # -> graft(Start), graft(End)
merge_20 = Merge(Data1=merge_15, Data2=merge_19, Data3=offset_18)  # -> flatten(Result)
merge_21 = Merge(Data1=join_7, Data2=join_8)
panel_3 = Panel(merge_20)
ln_34 = Line(StartPoint=end_19.End, EndPoint=end_20.End)
ln_35 = Line(StartPoint=end_19.Start, EndPoint=end_20.Start)
join_9 = JoinCurves(Curves=merge_20, Preserve=False)
merge_22 = Merge(Data1=ext_4, Data2=offset_19, Data3=ln_35, Data4=ln_34)  # -> flatten(Result)
Z_2 = UnitZ(Factor=thisckness_of_the_material_2)
rdiff_4 = RegionDifference(CurvesA=rectangle_2.Rectangle, CurvesB=join_9)
join_10 = JoinCurves(Curves=merge_22, Preserve=False)
rdiff_5 = RegionDifference(CurvesA=rdiff_4, CurvesB=join_10)
runion_2 = RegionUnion(Curves=merge_21)
rdiff_6 = RegionDifference(CurvesA=rdiff_5, CurvesB=runion_2)
extr_3 = Extrude(Base=rdiff_5, Direction=Z_2)
extr_4 = Extrude(Base=rdiff_6, Direction=Z_2)
cap_3 = CapHoles(Brep=extr_3)
cap_4 = CapHoles(Brep=extr_4)

# ---- group: Previous Components design / Connector - two versions
number_slider_10 = Slider(100, range=0..1000)  # disabled
number_slider_11 = Slider(100, range=0..1000)  # disabled
xy = XYPlane(Origin=Point(0, 0, 0))  # disabled
rectangle_3 = Rectangle(Plane=xy, XSize=number_slider_10, YSize=number_slider_11, Radius=0)  # -> Rectangle, Length; disabled

# ---- group: recreation of bounding boxes
number_slider_12 = Slider(100, range=0..100)
rectangle_4 = Rectangle(Plane=PlaneXY(0, 0, 0), XSize=number_slider_12, YSize=number_slider_12, Radius=0)  # -> Rectangle, Length
boxrec = BoxRectangle(Rectangle=rectangle_4.Rectangle, Height=Slider(200, range=0..1000))

# ----
bbox = BoundingBox(Content=boxrec, Plane=PlaneXY(0, 0, 0), UnionBox=True)  # -> Box, Box_2

# ---- group: UDP import objects
# UDP_receiver from Unity
# Activate the Unity UDP send to have flowing data
panel_4 = Panel("127.0.0.1")
udp = UDPReceiver(Address=panel_4, Port="8050", Pattern=0)  # -> Info, Data
rec = DataRecorder(udp.Data, DataLimit=-10, RecordData=True)
split = TextSplit(Text=rec, Separators="(")
join_11 = TextJoin(Text=split, Join="{")
panel_5 = Panel(rec)
split_2 = TextSplit(Text=join_11, Separators=")")
join_12 = TextJoin(Text=split_2, Join="}")  # -> flatten(Result)
X = UnitX(Factor=1)
pt_5 = Point(join_12)
rot3d = Rotate3D(Geometry=pt_5, Angle=degrees(Slider(90, range=0..100)), Center=Point(0, 0, 0), Axis=X)  # -> Geometry, Transform
scale = Scale(Geometry=rot3d.Geometry, Center=Point(0, 0, 0), Factor=Slider(100, range=0.1..100))  # -> Geometry, Transform
cullpt = CullDuplicates(Points=scale.Geometry, Tolerance=0.1, CullMode=3)  # -> Points, Indices, Valence

# ----
panel_6 = Panel(cullpt.Points)
xy_2 = XYPlane(Origin=cullpt.Points)

# ---- group: UDP import objects / Distribution of objects
volume = Volume(Geometry=bbox.Box)  # -> Volume, Centroid
orient = Orient(Geometry=boxrec, Source=volume.Centroid, Target=xy_2)  # -> Geometry, Transform

# ----
xy_3 = XYPlane(Origin=Point(0, 0, 0))

# ---- group: Rotation and whole assembly / custom component
brep = Brep([<brep referenced from the Rhino model> x3])
group = Group(Objects=brep)

# ---- group: Previous Components design
number_slider_13 = Slider(-39.5, range=-100..100.01)  # disabled
number_slider_14 = Slider(0.47, range=0..1)  # disabled

# ---- group: Previous Components design / Long component
xy_4 = XYPlane(Origin=Point(0, 0, 0))  # disabled
number_slider_15 = Slider(79, range=0..1000)  # disabled
number_slider_16 = Slider(249.25, range=0..1000)  # disabled
X_2 = UnitX(Factor=number_slider_13)  # disabled
move_3 = Move(Geometry=xy_4, Motion=X_2)  # -> Geometry, Transform; disabled
rectangle_5 = Rectangle(Plane=move_3.Geometry, XSize=number_slider_15, YSize=number_slider_16, Radius=0)  # -> Rectangle, Length; disabled
thisckness_of_the_material_tolerance = Slider(9.05, range=0..12)  # disabled
area_3 = Area(Geometry=rectangle_5.Rectangle)  # -> Area, Centroid; disabled
debrep_4 = DeconstructBrep(Brep=rectangle_5.Rectangle)  # -> Faces, Edges, Vertices; disabled
midpt_2 = CurveMiddle(Curve=debrep_4.Edges)  # disabled
number_slider_17 = Slider(3, range=-10..11)  # disabled
panel_7 = Panel("2")  # disabled
shift = ShiftList(List=midpt_2, Shift=number_slider_17, Wrap=True)  # disabled
division_5 = Division(A=thisckness_of_the_material_tolerance, B=panel_7)  # disabled
ln_36 = Line(StartPoint=area_3.Centroid, EndPoint=midpt_2)  # disabled
ln_37 = Line(StartPoint=shift, EndPoint=debrep_4.Vertices)  # disabled
ln_38 = Line(StartPoint=midpt_2, EndPoint=debrep_4.Vertices)  # disabled
neg_9 = Negative(Value=division_5)  # disabled
ln_39 = Line(StartPoint=area_3.Centroid, EndPoint=debrep_4.Vertices)  # disabled
number_slider_18 = Slider(0.5, range=0..1)  # disabled
merge_23 = Merge(Data1=ln_38, Data2=ln_37)  # disabled
offset_20 = OffsetCurve(Curve=ln_36, Distance=neg_9, Corners=1)  # disabled
offset_21 = OffsetCurve(Curve=ln_36, Distance=division_5, Corners=1)  # disabled
curvepoint = PointOnCurve(ln_36, parameter=0.5)  # disabled
eval = EvaluateCurve(Curve=reparameterize(ln_39), Parameter=number_slider_18)  # -> Point, Tangent, Angle; disabled
crv_cp = CurveClosestPoint(Point=curvepoint, Curve=flatten(offset_20))  # -> Point, Parameter, Distance; disabled
crv_cp_2 = CurveClosestPoint(Point=curvepoint, Curve=flatten(offset_21))  # -> Point, Parameter, Distance; disabled
offset_22 = OffsetCurve(Curve=ln_39, Distance=neg_9, Corners=1)  # disabled
graft = GraftTree(Tree=eval.Point, IncludeEmptyLists=True, IncludeNullItems=True)  # disabled
offset_23 = OffsetCurve(Curve=ln_39, Distance=division_5, Corners=1)  # disabled
crv_cp_3 = CurveClosestPoint(Point=flatten(graft), Curve=flatten(offset_23))  # -> Point, Parameter, Distance; disabled
crv_cp_4 = CurveClosestPoint(Point=flatten(graft), Curve=flatten(offset_22))  # -> Point, Parameter, Distance; disabled
ln_40 = Line(StartPoint=crv_cp_2.Point, EndPoint=crv_cp.Point)  # disabled
ln_41 = Line(StartPoint=crv_cp_3.Point, EndPoint=crv_cp_4.Point)  # disabled
vec2pt_3 = Vector2Pt(PointA=area_3.Centroid, PointB=debrep_4.Vertices, Unitize=False)  # -> Vector, Length; disabled
number_slider_19 = Slider(0.5, range=0..1)  # disabled
number_slider_20 = Slider(0.5, range=0..1)  # disabled
multiplication_3 = Multiplication(A=vec2pt_3.Vector, B=number_slider_19)  # disabled
move_4 = Move(Geometry=ln_41, Motion=multiplication_3)  # -> Geometry, Transform; disabled
end_21 = EndPoints(Curve=ln_41)  # -> Start, End; disabled
end_22 = EndPoints(Curve=move_4.Geometry)  # -> Start, End; disabled
ln_42 = Line(StartPoint=end_21.Start, EndPoint=end_22.Start)  # disabled
ln_43 = Line(StartPoint=end_21.End, EndPoint=end_22.End)  # disabled
entwine = Entwine(Branch00=ln_41, Branch01=ln_43, Branch02=move_4.Geometry, Branch03=ln_42, FlattenInputs=True)  # -> flatten(Result); disabled
panel_8 = Panel("""1
3""")  # disabled
panel_9 = Panel("""0
2""")  # disabled
number_slider_21 = Slider(0, range=0..100)  # disabled
xy_5 = XYPlane(Origin=Point(0, 0, 0))  # disabled
number_slider_22 = Slider(9, range=0..10)  # disabled
join_13 = JoinCurves(Curves=entwine, Preserve=False)  # disabled
Z_3 = UnitZ(Factor=number_slider_22)  # disabled
panel_10 = Panel("2")  # disabled
panel_11 = Panel("{1,0,0}")  # disabled

# ---- group: Previous Components design / Longer slot definition
item_14 = ListItem(List=ln_36, Index=0, Wrap=True)  # -> Item, Item1, Item2, Item3; disabled
geo_3 = Geometry(item_14.Item)  # disabled
geo_4 = Geometry(item_14.Item2)  # disabled
merge_24 = Merge(Data1=geo_3, Data2=geo_4)  # -> flatten(Result); disabled
curvepoint_2 = PointOnCurve(merge_24, parameter=0.803)  # disabled
offset_24 = OffsetCurve(Curve=merge_24, Distance=neg_9, Corners=1)  # disabled
offset_25 = OffsetCurve(Curve=merge_24, Distance=division_5, Corners=1)  # disabled
crv_cp_5 = CurveClosestPoint(Point=curvepoint_2, Curve=flatten(offset_25))  # -> Point, Parameter, Distance; disabled
crv_cp_6 = CurveClosestPoint(Point=curvepoint_2, Curve=flatten(offset_24))  # -> Point, Parameter, Distance; disabled
ln_44 = Line(StartPoint=crv_cp_5.Point, EndPoint=crv_cp_6.Point)  # disabled
number_slider_23 = Slider(0, range=0..1)  # disabled
item_15 = ListItem(List=ln_44, Index=0, Wrap=True)  # -> Item, Item1; disabled
number_slider_24 = Slider(2, range=0..10)  # disabled
replace = ReplaceItems(List=ln_40, Item=item_15.Item, Indices=number_slider_23, Wrap=False)  # disabled
replace_2 = ReplaceItems(List=replace, Item=item_15.Item1, Indices=number_slider_24, Wrap=False)  # disabled

# ---- group: Previous Components design / Long component / Chamfer
curvepoint_3 = PointOnCurve(merge_23, parameter=0.333)  # disabled

# ---- group: Previous Components design / Connector - two versions
thisckness_of_the_material_tolerance_2 = Slider(9.05, range=0..12)  # disabled
area_4 = Area(Geometry=rectangle_3.Rectangle)  # -> Area, Centroid; disabled
debrep_5 = DeconstructBrep(Brep=rectangle_3.Rectangle)  # -> Faces, Edges, Vertices; disabled
number_slider_25 = Slider(3, range=-10..11)  # disabled
midpt_3 = CurveMiddle(Curve=debrep_5.Edges)  # disabled
panel_12 = Panel("2")  # disabled
shift_2 = ShiftList(List=midpt_3, Shift=number_slider_25, Wrap=True)  # disabled
division_6 = Division(A=thisckness_of_the_material_tolerance_2, B=panel_12)  # disabled
ln_45 = Line(StartPoint=shift_2, EndPoint=debrep_5.Vertices)  # disabled
ln_46 = Line(StartPoint=midpt_3, EndPoint=debrep_5.Vertices)  # disabled
ln_47 = Line(StartPoint=area_4.Centroid, EndPoint=midpt_3)  # disabled
ln_48 = Line(StartPoint=area_4.Centroid, EndPoint=debrep_5.Vertices)  # disabled
neg_10 = Negative(Value=division_6)  # disabled
merge_25 = Merge(Data1=ln_46, Data2=ln_45)  # disabled
offset_26 = OffsetCurve(Curve=ln_47, Distance=division_6, Corners=1)  # disabled
offset_27 = OffsetCurve(Curve=ln_47, Distance=neg_10, Corners=1)  # disabled
curvepoint_4 = PointOnCurve(ln_47, parameter=0.605)  # disabled
eval_2 = EvaluateCurve(Curve=reparameterize(ln_48), Parameter=number_slider_14)  # -> Point, Tangent, Angle; disabled
graft_2 = GraftTree(Tree=eval_2.Point, IncludeEmptyLists=True, IncludeNullItems=True)  # disabled
offset_28 = OffsetCurve(Curve=ln_48, Distance=neg_10, Corners=1)  # disabled
offset_29 = OffsetCurve(Curve=ln_48, Distance=division_6, Corners=1)  # disabled
crv_cp_7 = CurveClosestPoint(Point=flatten(graft_2), Curve=flatten(offset_29))  # -> Point, Parameter, Distance; disabled
crv_cp_8 = CurveClosestPoint(Point=flatten(graft_2), Curve=flatten(offset_28))  # -> Point, Parameter, Distance; disabled
crv_cp_9 = CurveClosestPoint(Point=curvepoint_4, Curve=flatten(offset_26))  # -> Point, Parameter, Distance; disabled
crv_cp_10 = CurveClosestPoint(Point=curvepoint_4, Curve=flatten(offset_27))  # -> Point, Parameter, Distance; disabled
ln_49 = Line(StartPoint=crv_cp_7.Point, EndPoint=crv_cp_8.Point)  # disabled
vec2pt_4 = Vector2Pt(PointA=area_4.Centroid, PointB=debrep_5.Vertices, Unitize=False)  # -> Vector, Length; disabled
ln_50 = Line(StartPoint=crv_cp_9.Point, EndPoint=crv_cp_10.Point)  # disabled
number_slider_26 = Slider(0.5, range=0..1)  # disabled
number_slider_27 = Slider(0.5, range=0..1)  # disabled
multiplication_4 = Multiplication(A=vec2pt_4.Vector, B=number_slider_26)  # disabled
move_5 = Move(Geometry=ln_49, Motion=multiplication_4)  # -> Geometry, Transform; disabled
end_23 = EndPoints(Curve=ln_50)  # -> Start, End; disabled
end_24 = EndPoints(Curve=ln_49)  # -> Start, End; disabled
end_25 = EndPoints(Curve=move_5.Geometry)  # -> Start, End; disabled
ln_51 = Line(StartPoint=end_24.Start, EndPoint=end_25.Start)  # disabled
ln_52 = Line(StartPoint=end_24.End, EndPoint=end_25.End)  # disabled
entwine_2 = Entwine(Branch00=ln_49, Branch01=ln_52, Branch02=move_5.Geometry, Branch03=ln_51, FlattenInputs=True)  # -> flatten(Result); disabled
panel_13 = Panel("""1
3""")  # disabled
panel_14 = Panel("""0
2""")  # disabled
xy_6 = XYPlane(Origin=Point(0, 0, 0))  # disabled
number_slider_28 = Slider(9, range=0..10)  # disabled
join_14 = JoinCurves(Curves=entwine_2, Preserve=False)  # disabled
Z_4 = UnitZ(Factor=number_slider_28)  # disabled

# ---- group: Previous Components design / Connector - two versions / Chamfer
curvepoint_5 = PointOnCurve(merge_25, parameter=0.5)  # disabled

# ---- group: Previous Components design / Connector - two versions (continued)
alongcrv = SortAlongCurve(Points=flatten(curvepoint_5), Curve=rectangle_3.Rectangle)  # -> Points, Indices; disabled
pline = PolyLine(Vertices=alongcrv.Points, Closed=True)  # disabled
ccx_3 = CurveCurve(CurveA=flatten(offset_26), CurveB=pline)  # -> flatten(Points), ParamsA, ParamsB; disabled
ccx_4 = CurveCurve(CurveA=flatten(offset_27), CurveB=pline)  # -> flatten(Points), ParamsA, ParamsB; disabled
ln_53 = Line(StartPoint=ccx_4.Points, EndPoint=ccx_3.Points)  # -> flatten(Line); disabled
midpt_4 = CurveMiddle(Curve=ln_53)  # disabled
vec2pt_5 = Vector2Pt(PointA=area_4.Centroid, PointB=midpt_4, Unitize=False)  # -> Vector, Length; disabled
multiplication_5 = Multiplication(A=vec2pt_5.Vector, B=number_slider_27)  # disabled
move_6 = Move(Geometry=ln_53, Motion=multiplication_5)  # -> Geometry, Transform; disabled
end_26 = EndPoints(Curve=move_6.Geometry)  # -> Start, End; disabled
ln_54 = Line(StartPoint=end_23.Start, EndPoint=end_26.End)  # disabled
ln_55 = Line(StartPoint=end_23.End, EndPoint=end_26.Start)  # disabled
ln_56 = Line(StartPoint=end_26.Start, EndPoint=end_26.End)  # disabled
entwine_3 = Entwine(Branch00=ln_50, Branch01=ln_55, Branch02=ln_56, Branch03=ln_54, FlattenInputs=True)  # -> flatten(Result); disabled
join_15 = JoinCurves(Curves=entwine_3, Preserve=False)  # disabled
item_16 = ListItem(List=join_15, Index=panel_14, Wrap=True)  # disabled
item_17 = ListItem(List=join_15, Index=panel_13, Wrap=True)  # disabled
rdiff_7 = RegionDifference(CurvesA=flatten(pline), CurvesB=flatten(join_15), Plane=xy_6)  # disabled
rdiff_8 = RegionDifference(CurvesA=rdiff_7, CurvesB=join_14)  # disabled
extr_5 = Extrude(Base=rdiff_7, Direction=Z_4)  # disabled
extr_6 = Extrude(Base=rdiff_8, Direction=Z_4)  # disabled
cap_5 = CapHoles(Brep=extr_6)  # disabled
cap_6 = CapHoles(Brep=extr_5)  # disabled

# ---- group: Previous Components design / Connector - two versions / additional slots
number_slider_29 = Slider(25, range=0..100)  # disabled
Y = UnitY(Factor=number_slider_29)  # disabled
Y_2 = UnitY(Factor=number_slider_29)  # disabled
neg_11 = Negative(Value=Y)  # disabled
move_7 = Move(Geometry=graft(item_17), Motion=[Y_2, neg_11])  # -> Geometry, Transform; disabled

# ---- group: Previous Components design / Connector - two versions (continued)
merge_26 = Merge(Data1=join_15, Data2=flatten(move_7.Geometry))  # disabled

# ---- group: Previous Components design / Long component (continued)
alongcrv_2 = SortAlongCurve(Points=flatten(curvepoint_3), Curve=rectangle_5.Rectangle)  # -> Points, Indices; disabled
pline_2 = PolyLine(Vertices=alongcrv_2.Points, Closed=True)  # disabled
ccx_5 = CurveCurve(CurveA=flatten(offset_20), CurveB=pline_2)  # -> flatten(Points), ParamsA, ParamsB; disabled
ccx_6 = CurveCurve(CurveA=flatten(offset_21), CurveB=pline_2)  # -> flatten(Points), ParamsA, ParamsB; disabled
ln_57 = Line(StartPoint=ccx_5.Points, EndPoint=ccx_6.Points)  # -> flatten(Line); disabled
midpt_5 = CurveMiddle(Curve=ln_57)  # disabled
vec2pt_6 = Vector2Pt(PointA=area_3.Centroid, PointB=midpt_5, Unitize=False)  # -> Vector, Length; disabled
multiplication_6 = Multiplication(A=vec2pt_6.Vector, B=number_slider_20)  # disabled
move_8 = Move(Geometry=ln_57, Motion=multiplication_6)  # -> Geometry, Transform; disabled
end_27 = EndPoints(Curve=replace_2)  # -> Start, End; disabled
end_28 = EndPoints(Curve=move_8.Geometry)  # -> Start, End; disabled
ln_58 = Line(StartPoint=end_27.End, EndPoint=end_28.Start)  # disabled
ln_59 = Line(StartPoint=end_27.Start, EndPoint=end_28.End)  # disabled
ln_60 = Line(StartPoint=end_28.Start, EndPoint=end_28.End)  # disabled
entwine_4 = Entwine(Branch00=ln_40, Branch01=ln_58, Branch02=ln_60, Branch03=ln_59, Branch04=replace_2, FlattenInputs=True)  # -> flatten(Result); disabled
join_16 = JoinCurves(Curves=entwine_4, Preserve=False)  # disabled
item_18 = ListItem(List=join_16, Index=panel_8, Wrap=True)  # disabled
item_19 = ListItem(List=join_16, Index=panel_9, Wrap=True)  # disabled
fillet_2 = FilletDistance(Curve=pline_2, Distance=number_slider_21)  # disabled

# ---- group: Previous Components design / Long component / additional slots
number_slider_30 = Slider(0, range=0..100)  # disabled
Y_3 = UnitY(Factor=number_slider_30)  # disabled
Y_4 = UnitY(Factor=number_slider_30)  # disabled
neg_12 = Negative(Value=Y_3)  # disabled
move_9 = Move(Geometry=graft(item_18), Motion=[Y_4, neg_12])  # -> Geometry, Transform; disabled

# ---- group: Previous Components design / Long component (continued)
X_3 = UnitX(Factor=number_slider_30)  # disabled
neg_13 = Negative(Value=X_3)  # disabled
move_10 = Move(Geometry=graft(item_19), Motion=[X_3, neg_13])  # -> Geometry, Transform; disabled
merge_27 = Merge(Data1=flatten(item_19), Data2=flatten(move_9.Geometry))  # disabled
rdiff_9 = RegionDifference(CurvesA=flatten(fillet_2), CurvesB=flatten(merge_27), Plane=xy_5)  # disabled
rdiff_10 = RegionDifference(CurvesA=rdiff_9, CurvesB=join_13)  # disabled
extr_7 = Extrude(Base=rdiff_9, Direction=Z_3)  # disabled
extr_8 = Extrude(Base=rdiff_10, Direction=Z_3)  # disabled
cap_7 = CapHoles(Brep=extr_8)  # disabled
Z_5 = UnitZ(Factor=number_slider_30)  # disabled
multiplication_7 = Multiplication(A=Z_5, B=panel_10)  # disabled
move_11 = Move(Geometry=cap_7, Motion=multiplication_7)  # -> Geometry, Transform; disabled
merge_28 = Merge(Data1=cap_7, Data2=move_11.Geometry)  # disabled
bbox_2 = BoundingBox(Content=merge_28, Plane=PlaneXY(0, 0, 0), UnionBox=True)  # -> Box, Box_2; disabled
volume_2 = Volume(Geometry=bbox_2.Box)  # -> Volume, Centroid; disabled
cap_8 = CapHoles(Brep=extr_7)  # disabled
rot3d_2 = Rotate3D(Geometry=cap_8, Angle=1.570796327, Center=volume_2.Centroid, Axis=panel_11)  # -> Geometry, Transform; disabled

# ---- group: Previous Components design (continued)
item_20 = ListItem(List=midpt_2, Index=1, Wrap=True)  # -> Item, Item1; disabled
item_21 = ListItem(List=midpt_2, Index=1, Wrap=True)  # disabled
item_22 = ListItem(List=ln_40, Index=1, Wrap=True)  # disabled
geo_5 = Geometry(rot3d_2.Geometry)  # disabled

# ---- group: Previous Components design / measurement of the slot
pull_4 = PullPoint(Point=item_21, Geometry=item_22, ClosestOnly=True)  # -> ClosestPoint, Distance; disabled
dist = Distance(PointA=item_21, PointB=pull_4.ClosestPoint)  # disabled
panel_15 = Panel(dist)  # disabled

# ---- group: Previous Components design / just test / measurement of the slots
pull_5 = PullPoint(Point=item_20.Item1, Geometry=ln_44, ClosestOnly=True)  # -> ClosestPoint, Distance; disabled
dist_2 = Distance(PointA=item_20.Item1, PointB=pull_5.ClosestPoint)  # disabled
panel_16 = Panel(dist_2)  # disabled

# ---- group: Or FBX imported geometry
fbx_imprt_from_unity = Mesh([<mesh referenced from the Rhino model> x52])

# ----
# FBX imported geometry
bbox_3 = BoundingBox(Content=fbx_imprt_from_unity, Plane=PlaneXY(0, 0, 0))  # -> Box, Box_2

# ---- group: Or FBX imported geometry (continued)
volume_3 = Volume(Geometry=bbox_3.Box)  # -> Volume, flatten(Centroid)

# ---- group: Collision detection
cullpt_2 = CullDuplicates(Points=volume_3.Centroid, Tolerance=Slider(99, range=0..1000), CullMode=3)  # -> Points, Indices, Valence
rectangle_6 = Rectangle(Plane=PlaneXY(0, 0, 0), XSize=Domain(0, 100), YSize=Domain(0, 100), Radius=0)  # -> Rectangle, Length
boxrec_2 = BoxRectangle(Rectangle=rectangle_6.Rectangle, Height=Slider(200, range=0..1000))
volume_4 = Volume(Geometry=boxrec_2)  # -> Volume, Centroid
orient_2 = Orient(Geometry=boxrec_2, Source=volume_4.Centroid, Target=cullpt_2.Points)  # -> flatten(Geometry), Transform
volume_5 = Volume(Geometry=orient_2.Geometry)  # -> Volume, Centroid
scale_2 = Scale(Geometry=orient_2.Geometry, Center=volume_5.Centroid, Factor=0.5)  # -> Geometry, Transform
colmm = CollisionManyMany(Colliders=scale_2.Geometry)  # -> Collision, Indices
invbool = InvertBoolean(Boolean=colmm.Collision)  # -> Inverted, Number
cull = CullPattern(List=orient_2.Geometry, CullPattern=colmm.Collision)  # disabled
number_slider_31 = Slider(150, range=0..1000)  # disabled
volume_6 = Volume(Geometry=cull)  # -> Volume, Centroid; disabled
cullpt_3 = CullDuplicates(Points=volume_6.Centroid, Tolerance=number_slider_31, CullMode=3)  # -> Points, Indices, Valence; disabled
orient_3 = Orient(Geometry=boxrec_2, Source=volume_4.Centroid, Target=cullpt_3.Points)  # -> flatten(Geometry), Transform; disabled
cull_2 = CullPattern(List=orient_2.Geometry, CullPattern=invbool.Inverted)
merge_29 = Merge(Data1=cull_2)

# ----
area_5 = Area(Geometry=merge_29)  # -> Area, Centroid

# ---- group: selection which parts will be grabbed by the robot
bbox_4 = BoundingBox(Content=merge_29, Plane=PlaneXY(0, 0, 0))  # -> Box, Box_2
geo_6 = Geometry(bbox_4.Box)
geo_7 = Geometry(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)

# ----
item_23 = ListItem(List=bbox_4.Box, Index=Slider(46, range=0..100), Wrap=True)

# ---- group: Robotic simulation / scaling down - adjustment of the size according to the robotic system
scale_3 = Scale(Geometry=geo_6, Center=Point(0, 0, 0), Factor=0.5)  # -> Geometry, Transform

# ---- group: Sorting geometry according to the distance from the XY plane - definition which parts are rotated
project = Project(Geometry=area_5.Centroid, Plane=xy_3)  # -> Geometry, Transform
dist_3 = Distance(PointA=area_5.Centroid, PointB=project.Geometry)
round = Round(Number=dist_3)  # -> Nearest, flatten(Floor), Ceiling
sort = SortList(Keys=round.Floor, ValuesA=flatten(area_5.Centroid))  # -> Keys, ValuesA
smaller = SmallerThan(FirstNumber=sort.Keys, SecondNumber="200")  # -> SmallerThan, OrEqualTo
larger = LargerThan(FirstNumber=sort.Keys, SecondNumber="0")  # -> LargerThan, OrEqualTo
larger_2 = LargerThan(FirstNumber=sort.Keys, SecondNumber="200")  # -> LargerThan, OrEqualTo
smaller_2 = SmallerThan(FirstNumber=sort.Keys, SecondNumber="400")  # -> SmallerThan, OrEqualTo
larger_3 = LargerThan(FirstNumber=sort.Keys, SecondNumber="400")  # -> LargerThan, OrEqualTo
smaller_3 = SmallerThan(FirstNumber=sort.Keys, SecondNumber="600")  # -> SmallerThan, OrEqualTo
larger_4 = LargerThan(FirstNumber=sort.Keys, SecondNumber="600")  # -> LargerThan, OrEqualTo
smaller_4 = SmallerThan(FirstNumber=sort.Keys, SecondNumber="800")  # -> SmallerThan, OrEqualTo
larger_5 = LargerThan(FirstNumber=sort.Keys, SecondNumber="800")  # -> LargerThan, OrEqualTo
smaller_5 = SmallerThan(FirstNumber=sort.Keys, SecondNumber="1000")  # -> SmallerThan, OrEqualTo
larger_6 = LargerThan(FirstNumber=sort.Keys, SecondNumber="1000")  # -> LargerThan, OrEqualTo
smaller_6 = SmallerThan(FirstNumber=sort.Keys, SecondNumber="1200")  # -> SmallerThan, OrEqualTo
and = GateAnd(A=larger.LargerThan, B=smaller.SmallerThan)
and_2 = GateAnd(A=larger_2.LargerThan, B=smaller_2.SmallerThan)
and_3 = GateAnd(A=larger_3.LargerThan, B=smaller_3.SmallerThan)
and_4 = GateAnd(A=larger_4.LargerThan, B=smaller_4.SmallerThan)
and_5 = GateAnd(A=larger_5.LargerThan, B=smaller_5.SmallerThan)
and_6 = GateAnd(A=larger_6.LargerThan, B=smaller_6.SmallerThan)
cull_3 = CullPattern(List=sort.ValuesA, CullPattern=and)
cull_4 = CullPattern(List=sort.ValuesA, CullPattern=and_5)
cull_5 = CullPattern(List=sort.ValuesA, CullPattern=and_3)
cull_6 = CullPattern(List=sort.ValuesA, CullPattern=and_2)
cull_7 = CullPattern(List=sort.ValuesA, CullPattern=and_4)
cull_8 = CullPattern(List=sort.ValuesA, CullPattern=and_6)
merge_30 = Merge(Data1=cull_6, Data2=cull_7, Data3=cull_8)

# ----
panel_17 = Panel(round.Floor)
larger_7 = LargerThan(FirstNumber=sort.Keys, SecondNumber="1200")  # -> LargerThan, OrEqualTo
smaller_7 = SmallerThan(FirstNumber=sort.Keys, SecondNumber="1400")  # -> SmallerThan, OrEqualTo
larger_8 = LargerThan(FirstNumber=sort.Keys, SecondNumber="1400")  # -> LargerThan, OrEqualTo
smaller_8 = SmallerThan(FirstNumber=sort.Keys, SecondNumber="1600")  # -> SmallerThan, OrEqualTo
larger_9 = LargerThan(FirstNumber=sort.Keys, SecondNumber="1600")  # -> LargerThan, OrEqualTo
smaller_9 = SmallerThan(FirstNumber=sort.Keys, SecondNumber="1800")  # -> SmallerThan, OrEqualTo
and_7 = GateAnd(A=larger_7.LargerThan, B=smaller_7.SmallerThan)
and_8 = GateAnd(A=larger_8.LargerThan, B=smaller_8.SmallerThan)
and_9 = GateAnd(A=larger_9.LargerThan, B=smaller_9.SmallerThan)
cull_9 = CullPattern(List=sort.ValuesA, CullPattern=and_7)
cull_10 = CullPattern(List=sort.ValuesA, CullPattern=and_8)
cull_11 = CullPattern(List=sort.ValuesA, CullPattern=and_9)

# ---- group: Sorting geometry according to the distance from the XY plane - definition which parts are rotated (continued)
merge_31 = Merge(Data1=cull_3, Data2=cull_5, Data3=cull_4, Data4=cull_9, Data5=cull_10, Data6=cull_11)

# ---- group: Rotation and whole assembly
xy_7 = XYPlane(Origin=merge_30)
xy_8 = XYPlane(Origin=merge_31)
bbox_5 = BoundingBox(Content=group, Plane=PlaneXY(0, 0, 0), UnionBox=True)  # -> Box, Box_2
volume_7 = Volume(Geometry=bbox_5.Box)  # -> Volume, Centroid
orient_4 = Orient(Geometry=group, Source=volume_7.Centroid, Target=xy_8)  # -> Geometry, Transform
bbox_6 = BoundingBox(Content=orient_4.Geometry, Plane=PlaneXY(0, 0, 0), UnionBox=False)  # -> Box, Box_2
neg_14 = Negative(Value=Slider(10, range=0..10))
addition_3 = Addition(A=Slider(50, range=0..100), B=Slider(0, range=0..10))
addition_4 = Addition(A=Slider(100, range=0..100), B=neg_14)
volume_8 = Volume(Geometry=bbox_6.Box)  # -> Volume, Centroid
X_4 = UnitX(Factor=addition_4)
Y_5 = UnitY(Factor=addition_3)
neg_15 = Negative(Value=X_4)
rot3d_3 = Rotate3D(Geometry=orient_4.Geometry, Angle=1.570796327, Center=volume_8.Centroid, Axis=Vector(0, 0, 1))  # -> Geometry, Transform
addition_5 = Addition(A=X_4, B=Y_5)
orient_5 = Orient(Geometry=group, Source=volume_7.Centroid, Target=xy_7)  # -> Geometry, Transform
move_12 = Move(Geometry=rot3d_3.Geometry, Motion=addition_5)  # -> Geometry, Transform
merge_32 = Merge(Data1=orient_5.Geometry, Data2=move_12.Geometry)
xz = XZPlane(Origin=Point(0, 0, 0))
mirror = Mirror(Geometry=merge_32, Plane=xz)  # -> Geometry, Transform

# ----
merge_33 = Merge(Data1=merge_32, Data2=mirror.Geometry)  # -> flatten(Result)
ungroup = Ungroup(Group=merge_33)
lng = ListLength(List=flatten(ungroup))
panel_18 = Panel(lng)

# ---- group: CNC production
ungroup_2 = Ungroup(Group=merge_32)
brep_2 = Brep(ungroup_2)
debrep_6 = DeconstructBrep(Brep=brep_2)  # -> Faces, Edges, Vertices
area_6 = Area(Geometry=debrep_6.Faces)  # -> Area, Centroid
sort_2 = SortList(Keys=area_6.Area, ValuesA=debrep_6.Faces)  # -> Keys, ValuesA
larger_10 = LargerThan(FirstNumber=sort_2.Keys, SecondNumber=Slider(1000, range=0..1000))  # -> LargerThan, OrEqualTo
dispatch = Dispatch(List=sort_2.ValuesA, DispatchPattern=larger_10.LargerThan)  # -> ListA, ListB
flip = Flip(Surface=dispatch.ListA)  # -> Surface, Result
panel_19 = Panel(sort_2.Keys)
shift_3 = ShiftList(List=flip.Surface, Shift="1", Wrap=True)
join_17 = BrepJoin(Breps=shift_3)  # -> simplify(Breps), Closed
brep_3 = Brep(join_17.Breps)
unroll = Unroll(MeshOrBrep=brep_3)  # -> Brep, Curves, Points, TextDotsLocation, TextDots
brep_4 = Brep(unroll.Brep)
edges = BrepEdges(Brep=brep_4)  # -> Naked, Interior, NonManifold
line = Line(simplify(flatten(edges.Naked)))
join_18 = JoinCurves(Curves=line, Preserve=False)
len = Length(Curve=join_18)
sort_3 = SortList(Keys=len, ValuesA=join_18)  # -> Keys, ValuesA
panel_20 = Panel(sort_3.Keys)
item_24 = ListItem(List=sort_3.ValuesA, Index="-1", Wrap=True)  # -> Item, Item1
crv_9 = Curve(sort_3.ValuesA)
crv_10 = Curve(item_24.Item)
crv_11 = Curve(item_24.Item1)
rectangle_7 = Rectangle(Plane=PlaneXY(0, 0, 0), XSize=Slider(1220, range=0..10000), YSize=Slider(2440, range=0..10000), Radius=0)  # -> Rectangle, Length
opennest = OpenNest(
    Sheets=rectangle_7.Rectangle,
    Geo=crv_9,
    Spacing=Slider(12, range=0..100),
    Placement=1,
    Tolerance=0.1,
    Rotations=4,
    Iterations=Slider(3, range=0..10),
    Seed=Slider(562, range=0..1000),
    Reset=Button(),
    Run=Toggle(False))  # -> Sheets, Geo, ID, Transform, IDS
lng_2 = ListLength(List=opennest.Geo)
panel_21 = Panel(opennest.Sheets)
geo_8 = Geometry(opennest.Geo)
panel_22 = Panel(lng_2)

# ----
lng_3 = ListLength(List=opennest.Sheets)
panel_23 = Panel(lng_3)

# ---- group: Robotic simulation / PLACE POSITION
geo_9 = Geometry(reverse(scale_3.Geometry))
bbox_7 = BoundingBox(Content=geo_9, Plane=PlaneXY(0, 0, 0))  # -> Box, Box_2
X_5 = UnitX(Factor=Slider(0, range=0..1000))
volume_9 = Volume(Geometry=bbox_7.Box)  # -> Volume, reverse(graft(Centroid))
Z_6 = UnitZ(Factor=Slider(30, range=0..1000))
Y_6 = UnitY(Factor=Slider(0, range=-50..100))
addition_6 = Addition(A=X_5, B=Z_6, C=Y_6)

# ----
project_2 = Project(Geometry=flatten(volume_9.Centroid), Plane=PlaneXY(0, 0, 0))  # -> Geometry, Transform
dist_4 = Distance(PointA=flatten(volume_9.Centroid), PointB=project_2.Geometry)
sort_4 = SortList(Keys=dist_4, ValuesA=flatten(volume_9.Centroid))  # -> Keys, ValuesA

# ---- group: Robotic simulation / PICK POSITION
geo_10 = Geometry(geo_7)
bbox_8 = BoundingBox(Content=geo_10, Plane=PlaneXY(0, 0, 0))  # -> Box, Box_2
volume_10 = Volume(Geometry=bbox_8.Box_2)  # -> Volume, Centroid
Z_7 = UnitZ(Factor=Slider(30, range=0..1000))
X_6 = UnitX(Factor=Slider(0, range=-150..1000))
Y_7 = UnitY(Factor=Slider(0, range=0..1000))
move_13 = Move(Geometry=volume_10.Centroid, Motion=Z_7)  # -> Geometry, Transform
addition_7 = Addition(A=X_6, B=Y_7)
move_14 = Move(Geometry=move_13.Geometry, Motion=addition_7)  # -> Geometry, Transform
pt_6 = Point(move_14.Geometry)
pl = ConstructPlane(Origin=pt_6, XAxis=expr("-X", Vector(1, 0, 0)), YAxis=Vector(0, 1, 0))

# ---- group: Robotic simulation / PICK POSITION / Pick Retract distance (hover) to avoid collisions
Z_8 = UnitZ(Factor=Slider(150, range=0..1000))
move_15 = Move(Geometry=pl, Motion=Z_8)  # -> Geometry, Transform
ins = InsertItems(List=pl, Item=move_15.Geometry, Indices=[0, -1], Wrap=True)

# ---- group: Robotic simulation / PICK POSITION (continued)
prot = RotatePlane(Plane=ins, Angle=degrees(Slider(90, range=0..1000)))

# ---- group: Robotic simulation / PLACE POSITION / Place retrack distance to avoid collisions
Z_9 = UnitZ(Factor=Slider(300, range=0..1000))

# ---- group: Robotic simulation / PLACE POSITION (continued)
move_16 = Move(Geometry=sort_4.ValuesA, Motion=addition_6)  # -> Geometry, Transform
pln = Plane(graft(move_16.Geometry))

# ---- group: Robotic simulation / PLACE POSITION / Place retrack distance to avoid collisions (continued)
move_17 = Move(Geometry=pln, Motion=Z_9)  # -> Geometry, Transform

# ----
points = PointList(Points=flatten(pln), Size=Slider(17, range=0..1000))

# ---- group: Robotic simulation / PLACE POSITION (continued)
ins_2 = InsertItems(List=pln, Item=move_17.Geometry, Indices=[0, -1], Wrap=True)

# ---- group: Robotic simulation / PLACE POSITION / This is significant how to position and rotate the end effector properly
pflip = FlipPlane(Plane=ins_2, ReverseX=False, ReverseY=True, SwapAxes=False)

# ---- group: Robotic simulation / PLACE POSITION (continued)
renumber = RenumberPaths(Data=pflip)  # -> reverse(RenumberedData)

# ---- group: Robotic simulation
# Pick and Place scenario - standard
# Frame is basically a certain definition of a vector according to witch the defined position of the targets are shifted=the tool position of the end effector in carthesian space. Some sort of a working plane.
number_slider_32 = Slider(2, range=0..10)
ins_3 = InsertItems(List=renumber, Item=prot, Indices=0, Wrap=True)  # -> simplify(graft(List))
trim_3 = TrimTree(Tree=ins_3, Depth=1)
panel_24 = Panel("0,pi/2,0,0,0,0")
panel_25 = Panel("pi/2,pi/2,0,0,0,0")
list = FlagFields({"Shoulder": 1, "Elbow": 2, "Wrist": 4}, selected=[])
pt_7 = Point(Point(-301.4381484, -78.78988678, 0))
list_2 = RobotsLibrary(
    {"Franka Emika Panda", "Bartlett-IRB120", "Bartlett-IRB1600", "Bartlett-KR6", "Bartlett-KR60-A", "Bartlett-KR60-B", "Bartlett-KR500", "Bartlett-KR60 on track", "Bartlett-UR10", "Bartlett-KR60", "Bartlett-TX200", "Bartlett-TX200L", "Bartlett-RX160", "Bartlett-RX160L", "UR3e", "UR5e", "UR10e", "UR16e", "UR3", "UR5", "UR10"}, selected="UR10e",
    Type=0)
load_robot = LoadRobotSystem(Name=list_2, Base=pt_7)

panel_26 = Panel("""0
0
0
1
1
1""")  # disabled
pt_8 = Point(Point(117.2692901, -26.54362745, 14.21676473))  # disabled
xy_9 = XYPlane(Origin=pt_8)  # disabled
null = Null(Count=1)  # disabled
frame = CreateFrame(Plane=xy_9, CoupledMechanicalGroup=-1, CoupledMechanism=-1)  # disabled
frame_2 = FrameParameter(frame)  # disabled
p_n_c = PickNChoose(Pattern=graft(panel_26), Stream0=null, Stream1=frame_2)  # -> flatten(Result); disabled
long = LongestList(ListA=trim_3, ListB=p_n_c, PaddingMode=2)  # -> ListA, graft(ListB); disabled
clean = CleanTree(RemoveNulls=True, RemoveInvalid=True, RemoveEmpty=False, Tree=long.ListB)  # disabled

panel_27 = Panel("""0
1
0
0
1
0""")
zone = ZoneParameter(Slider(6, range=0..10))
zone_2 = ZoneParameter(Slider(0, range=0..10))
p_n_c_2 = PickNChoose(Pattern=graft(panel_27), Stream0=zone, Stream1=zone_2)  # -> flatten(Result)
long_2 = LongestList(ListA=trim_3, ListB=p_n_c_2, PaddingMode=2)  # -> ListA, graft(ListB)

panel_28 = Panel("""0
1
1
0
1
1""")
tspeed = SpeedParameter(Slider(200, range=0..1000))
tpspeed = SpeedParameter(Slider(50, range=0..100))
list_3 = ValueList({"Joint", "Linear"}, selected="Joint")
list_4 = ValueList({"Joint", "Linear"}, selected="Linear")
p_n_c_3 = PickNChoose(Pattern=graft(panel_28), Stream0=list_3, Stream1=list_4)  # -> flatten(Result)
p_n_c_4 = PickNChoose(Pattern=graft(panel_28), Stream0=tspeed, Stream1=tpspeed)  # -> flatten(Result)
long_3 = LongestList(ListA=trim_3, ListB=p_n_c_3, PaddingMode=2)  # -> ListA, graft(ListB)
long_4 = LongestList(ListA=trim_3, ListB=p_n_c_4, PaddingMode=2)  # -> ListA, graft(ListB)

# ---- group: Robotic simulation / Gripper Open/CLose setup
number_slider_33 = Slider(1, range=0..1)
number_slider_34 = Slider(1, range=0..1)
wait = Wait(Time=number_slider_32)
wait_2 = Wait(Time=number_slider_32)
setdo = SetDO(DO=Slider(0, range=0..100), Value=Slider(1, range=0..1))
setdo_2 = SetDO(DO=Slider(0, range=0..100), Value=Slider(0, range=0..1))
panel_29 = Panel("""0
1
0
0
2
0""")
groupcmd = GroupCommand(Commands=[wait, setdo])
groupcmd_2 = GroupCommand(Commands=[wait_2, setdo_2])
null_2 = Null(Count=1)

# ---- group: Robotic simulation / Gripper Close
gripperclose = CommandParameter(groupcmd)

# ---- group: Robotic simulation / Gripper open
gripperopen = CommandParameter(groupcmd_2)

# ---- group: Robotic simulation / Gripper Open/CLose setup (continued)
p_n_c_5 = PickNChoose(Pattern=graft(panel_29), Stream0=null_2, Stream1=gripperclose, Stream2=gripperopen)  # -> flatten(Result)
long_5 = LongestList(ListA=trim_3, ListB=p_n_c_5, PaddingMode=2)  # -> ListA, graft(ListB)
clean_2 = CleanTree(RemoveNulls=True, RemoveInvalid=True, RemoveEmpty=False, Tree=long_5.ListB)

# ---- group: Tool setup
mesh = Mesh([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])
Z_10 = UnitZ(Factor=Slider(60, range=0..1000))

# ----
rotate = Rotate(Geometry=mesh, Angle=1.570796327, Plane=PlaneXY(0, 0, 0))  # -> Geometry, Transform

# ---- group: Tool setup (continued)
bbox_9 = BoundingBox(Content=rotate.Geometry, Plane=PlaneXY(0, 0, 0), UnionBox=True)  # -> Box, Box_2
volume_11 = Volume(Geometry=bbox_9.Box)  # -> Volume, Centroid
move_18 = Move(Geometry=volume_11.Centroid, Motion=Z_10)  # -> Geometry, Transform
pt_9 = Point(move_18.Geometry)
scale_4 = Scale(Geometry=rotate.Geometry, Center=Point(0, 0, 0), Factor=Slider(0.8, range=0..1))  # -> Geometry, Transform
xy_10 = XYPlane(Origin=pt_9)
mjoin = MeshJoin(Meshes=scale_4.Geometry)
tool = CreateTool(Name="gripper_pick_and_place", TCP=xy_10, Weight=Slider(0.5, range=0..1), Mesh=mjoin)  # -> Tool, TCP

# ---- group: Robotic simulation / Home position
target = CreateTarget(Joints="pi,-pi/1.5,pi/2,-pi/2,-pi/2,pi/2", Tool=tool.Tool, IsCartesian=False)

# ---- group: Robotic simulation (continued)
frame_3 = CreateFrame(Plane=xy_9, CoupledMechanicalGroup=-1, CoupledMechanism=-1)
panel_30 = Panel(frame_3)
panel_31 = Panel(clean)  # disabled
target_2 = CreateTarget(Plane=ins_3, RobConf=list, Motion=long_3.ListB, Tool=tool.Tool, Speed=long_4.ListB, Command=clean_2, IsCartesian=True)  # -> flatten(Target)
ins_4 = InsertItems(List=target_2, Item=target, Indices=[0, -1], Wrap=True)
program = CreateProgram(Name="Assembly", RobotSystem=load_robot, Targets=flatten(ins_4), StepSize=1)  # -> Program, Code, Duration, Warnings, Errors
panel_32 = Panel(program.Warnings)
sim = ProgramSimulation(Program=program.Program, Time=Slider(0, range=0..1), Normalized=True)  # -> SystemMeshes, JointRotations, Plane, Index, Time, Program, Errors
panel_33 = Panel(sim.Program)
split_3 = SplitList(List=sim.SystemMeshes, Index=7)  # -> ListA, ListB
preview = CustomPreview(Geometry=split_3.ListA, Material=ColourSwatch(SwatchColor=RGBA(255, 253, 252, 166)))
preview_2 = CustomPreview(Geometry=split_3.ListB, Material=ColourSwatch(SwatchColor=RGBA(0, 0, 0, 88)))
saveprog = SaveProgram(Program=sim.Program, Folder="D:\DF_workshop\DF2023\DF_workshop_setup\pick_place")
panel_34 = Panel(program.Code)
